# Grasshopper definition HB01-Program_Aggregation_DM.gh (Grasshopper 1.0.8)
# plug-ins: MeshEdit Components, Pufferfish, Human, Weaverbird, MetaHopper

# ----
# 01. DATA INPUTS
relay = Relay()
relay_2 = Relay()

relay_3 = Relay()
# Sometimes it gets laggy in arctic or rendered mode!
# Be careful and only turn on when needed.
# PREVIOUS STEP
# BACK TO START
relay_4 = Relay()

# ----
# Import Data from Google Docs WEB
# INSTRUCTIONS FOR LINKING GOOGLE SHEETS: 1. In your Google Sheet, go to:
# File > Share > Publish to the web.
# 
# 
# 
# 2. Select the specific sheet and change the format to "Comma-separated values (.csv)".
# 
# 
# 
# 3. Then Copy that link. This will be your file_path input. Paste above.
path = Panel("https://docs.google.com/spreadsheets/d/1wfTvFvqDC9etpZ6JlTr1bzA-sUI_EHOv_RLsK8haHYM/edit?usp=sharing")
refresh_csv = Button()
ipy2 = IronPython2Script(
    file_path=path,
    sheet_gid="883425988",
    refresh=refresh_csv,
    start_row="5",
    end_row="14",
    col_index_indexes="0",
    col_index_program_name="1",
    col_index_percentage="13",
    col_index_area="12",
    col_index_Tower_A="2",
    col_index_Tower_B="3",
    col_index_Tower_C="4",
    col_index_Podium="5",
    col_index_Ground="6")  # -> indexes, program_name, percentage, area, Tower_A, Tower_B, Tower_C, Podium, Ground; inputs start_row: Int32, col_index_program_name: Int32, col_index_percentage: Int32
# ---------- ipy2: IronPython ----------
"""
GOOGLE SHEETS READER - DINÁMICO & INFINITO
Inputs Necesarios:
    file_path: (str) URL del Google Sheet
    sheet_gid: (str/int) ID de la hoja
    refresh:   (bool) Botón
    start_row: (int) Fila inicial
    end_row:   (int) [Opcional] Fila final (o dejar vacío para leer todo)

Inputs Mágicos (Infinitos):
    col_index_A : índice para la columna A
    col_index_B : índice para la columna B
    col_index_C : ... agrega los que quieras (Zoom +)
    col_index_CualquierNombre : ...
"""
import clr
import csv
import urllib2
import os
import scriptcontext as sc

# --- 1. GESTIÓN DE INPUTS BÁSICOS ---
gid_str = "0"
if 'sheet_gid' in globals() and sheet_gid is not None:
    try: gid_str = str(int(float(sheet_gid)))
    except: gid_str = str(sheet_gid)

s_row = 0
if 'start_row' in globals() and start_row is not None:
    s_row = int(start_row)

e_row = None # Por defecto lee hasta el final
if 'end_row' in globals() and end_row is not None:
    e_row = int(end_row)

# Clave única para memoria
data_key = "csv_data_" + str(ghenv.Component.InstanceGuid)

# --- 2. FUNCIONES DE LECTURA ---
def get_google_csv_url(url, gid):
    if "docs.google.com" in url and "/spreadsheets/d/" in url:
        try:
            doc_id = url.split('/d/')[1].split('/')[0]
            return "https://docs.google.com/spreadsheets/d/{}/export?format=csv&gid={}".format(doc_id, gid)
        except: pass
    return url

def read_csv_data(path):
    print("Connecting...")
    try:
        if path.startswith("http"):
            response = urllib2.urlopen(path)
            reader = csv.reader(response)
            return list(reader)
        elif os.path.exists(path):
            with open(path, 'r') as f:
                reader = csv.reader(f)
                return list(reader)
    except Exception as e:
        print("Error: " + str(e))
        return None

# --- 3. REFRESH Y CARGA ---
if 'refresh' in globals() and refresh and file_path:
    target_path = get_google_csv_url(file_path, gid_str)
    new_data = read_csv_data(target_path)
    if new_data:
        sc.sticky[data_key] = new_data
        print("Update Successful!")

# --- 4. PROCESAMIENTO MÁGICO DE COLUMNAS ---
if data_key in sc.sticky:
    raw_data = sc.sticky[data_key]
    
    # Aplicar recorte de filas (Start / End)
    # Si e_row es None, slice va hasta el final [s_row:]
    data_slice = raw_data[s_row:e_row]
    
    print("Rows processed: " + str(len(data_slice)))

    # AQUÍ ESTÁ LA MAGIA:
    # Buscamos cualquier input que empiece por "col_index_"
    current_vars = globals().keys()
    
    for var_name in current_vars:
        if var_name.startswith("col_index_"):
            # 1. Identificar el nombre deseado (ej: "A" de "col_index_A")
            output_name = var_name.replace("col_index_", "")
            
            # 2. Obtener el índice de la columna
            col_idx = globals()[var_name]
            
            # 3. Extraer datos si el índice es válido
            result_list = []
            if col_idx is not None:
                idx = int(col_idx)
                for row in data_slice:
                    if len(row) > idx:
                        val = row[idx]
                        # Intentar convertir a float, si falla mantener texto
                        try: val = float(val)
                        except: pass
                        result_list.append(val)
                    else:
                        result_list.append(None) # Rellenar huecos si la fila es corta
            
            # 4. Asignar a una variable global para que salga por el componente
            globals()[output_name] = result_list
            print("Extracted column: " + output_name)

else:
    print("No data. Press Refresh.")
# ---------- end ipy2 ----------

panel = Panel(ipy2.Tower_C)
tower_c_levels = Data(panel)

panel_2 = Panel(ipy2.Tower_A)
tower_a_levels = Data(panel_2)

lng = ListLength(List=ipy2.indexes)

rep = ReplaceText(Text=ipy2.percentage, Find="%", Replace=" ", RecursiveReplace=False)

panel_3 = Panel(ipy2.Ground)
ground_levels = Data(panel_3)

panel_4 = Panel(ipy2.Tower_B)
tower_b_levels = Data(panel_4)

panel_5 = Panel(ipy2.Podium)
podium_levels = Data(panel_5)

panel_6 = Panel(ipy2.area)
m2_google_sheets = Data(panel_6)

panel_7 = Panel(ipy2.indexes)
index_google_sheets = Data(panel_7)

panel_8 = Panel(ipy2.program_name)
names_google_sheets = Data(panel_8)

panel_9 = Panel(rep)
percentages_numbers_google_sheets = Data(panel_9)

podium_labs = GetInteger(Slider(2, range=0..150), AtLeast=1, AtMost=1, Maximum=2147483647, Minimum=-2147483648, TreeAccess=False)
podium_amenities = GetInteger(Slider(0, range=0..150), AtLeast=1, AtMost=1, Maximum=2147483647, Minimum=-2147483648, TreeAccess=False)
podium_parking = GetInteger(Slider(6, range=0..150), AtLeast=1, AtMost=1, Maximum=2147483647, Minimum=-2147483648, TreeAccess=False)
entwine = Entwine(Branch00=podium_labs, Branch01=podium_parking, Branch02=podium_amenities, FlattenInputs=True)

ground_labs = GetInteger(Slider(0, range=0..150), AtLeast=1, AtMost=1, Maximum=2147483647, Minimum=-2147483648, TreeAccess=False)
ground_amenities = GetInteger(Slider(1, range=0..150), AtLeast=1, AtMost=1, Maximum=2147483647, Minimum=-2147483648, TreeAccess=False)
ground_parking = GetInteger(Slider(0, range=0..150), AtLeast=1, AtMost=1, Maximum=2147483647, Minimum=-2147483648, TreeAccess=False)
entwine_2 = Entwine(Branch00=ground_labs, Branch01=ground_parking, Branch02=ground_amenities, FlattenInputs=True)

relay_5 = Relay()
relay_6 = Relay()

ground_levels_2 = Data(entwine_2)
podium_levels_2 = Data(entwine)
entwine_3 = Entwine(Branch00=podium_levels_2, Branch01=ground_levels_2, FlattenInputs=True)

panel_10 = Panel("""2
1
0""")
item = ListItem(List=entwine_3, Index=panel_10, Wrap=True)

geo = Geometry(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)

tower_segments = GetInteger(Slider(6, range=0..10), AtLeast=1, AtMost=1, Maximum=2147483647, Minimum=-2147483648, TreeAccess=False)

towerc_offices = GetInteger(Slider(30, range=0..150), AtLeast=1, AtMost=1, Maximum=2147483647, Minimum=-2147483648, TreeAccess=False)
towerc_residential = GetInteger(Slider(60, range=0..150), AtLeast=1, AtMost=1, Maximum=2147483647, Minimum=-2147483648, TreeAccess=False)
towerc_hotel = GetInteger(Slider(40, range=0..150), AtLeast=1, AtMost=1, Maximum=2147483647, Minimum=-2147483648, TreeAccess=False)
entwine_4 = Entwine(Branch00=towerc_offices, Branch01=towerc_residential, Branch02=towerc_hotel, FlattenInputs=True)

towerb_offices = GetInteger(Slider(30, range=0..150), AtLeast=1, AtMost=1, Maximum=2147483647, Minimum=-2147483648, TreeAccess=False)
towerb_residential = GetInteger(Slider(50, range=0..150), AtLeast=1, AtMost=1, Maximum=2147483647, Minimum=-2147483648, TreeAccess=False)
towerb_hotel = GetInteger(Slider(30, range=0..150), AtLeast=1, AtMost=1, Maximum=2147483647, Minimum=-2147483648, TreeAccess=False)
entwine_5 = Entwine(Branch00=towerb_offices, Branch01=towerb_residential, Branch02=towerb_hotel, FlattenInputs=True)

towera_offices = GetInteger(Slider(30, range=0..150), AtLeast=1, AtMost=1, Maximum=2147483647, Minimum=-2147483648, TreeAccess=False)
towera_residential = GetInteger(Slider(40, range=0..150), AtLeast=1, AtMost=1, Maximum=2147483647, Minimum=-2147483648, TreeAccess=False)
towera_hotel = GetInteger(Slider(20, range=0..150), AtLeast=1, AtMost=1, Maximum=2147483647, Minimum=-2147483648, TreeAccess=False)
entwine_6 = Entwine(Branch00=towera_offices, Branch01=towera_residential, Branch02=towera_hotel, FlattenInputs=True)

giga_shaft_radius = Slider(15, range=0..100)
number_slider = Slider(4, range=0..10)

# ----
# CORE
pt = Point(Point(710.422997, -541.8954632, 584.208719))
xy = XYPlane(Origin=pt)
sec = MeshPlane(Mesh=geo, Plane=xy)  # -> graft(Curves)
area = Area(Geometry=sec)  # -> Area, Centroid
polygon = Polygon(Plane=area.Centroid, Radius=giga_shaft_radius, Segments=tower_segments, FilletRadius=0)  # -> Polygon, Length

core_dimensions = Slider(5, range=0..20)
# 02. BUILDING GEOMETRY
curve_to_boundary_surface = CurveToBoundarySurface(crv=polygon.Polygon, D=core_dimensions)  # -> M, R, C

vertical_program_dimensions = Slider(6, range=0..20)
curve_to_boundary_surface_2 = CurveToBoundarySurface(crv=curve_to_boundary_surface.C, D=vertical_program_dimensions)  # -> M, R, C

tower_a_levels_2 = Data(entwine_6)
tower_b_levels_2 = Data(entwine_5)
tower_c_levels_2 = Data(entwine_4)
entwine_7 = Entwine(Branch00=tower_c_levels_2, Branch01=tower_b_levels_2, Branch02=tower_a_levels_2, FlattenInputs=True)

panel_11 = Panel("""3
4
2""")
item_2 = ListItem(List=entwine_7, Index=panel_11, Wrap=True)

# ----
# PLANE FOR CAPSULES
number_slider_2 = Slider(4, range=0..20)
crv = Curve(curve_to_boundary_surface.C)
cluster = Cluster_2(C=crv, face_number=number_slider_2)
flippln = FlipPlane(Plane=cluster, FlipX=False, FlipY=False, FlipZ=True)  # -> Flipped, R

podium_hole_dimensions = Slider(-30, range=-100..0)

dom = ConstructDomain(DomainStart=Slider(0, range=-5..5), DomainEnd=Slider(0, range=-5..5))

# ----
# LEVEL HEIGHTS
floor_height = Slider(4.2, range=0..10)
num = Number(floor_height)

floor_height_2 = GetNumber(num, AtLeast=1, AtMost=1, Maximum=1.797693135e+308, Minimum=-1.797693135e+308, TreeAccess=False)
panel_12 = Panel(floor_height_2)

# ----
# Extrusion of Podium Program
ma = MassAddition(Input=flatten(item))  # -> Result, PartialResults
x_minus_one = XMinusOne(NumberX=ma.Result)
neg = Negative(Value=x_minus_one)
panel_13 = Panel(neg)
multiplication = Multiplication(A=panel_12, B=panel_13)
panel_14 = Panel(floor_height_2)
series = Series(Start=multiplication, Step=panel_14, Count=ma.Result)
Z = UnitZ(Factor=series)

panel_15 = Panel(floor_height_2)
cluster_2 = Cluster_3(crv=curve_to_boundary_surface_2.C, A=ma.Result, floor_height=panel_15)  # -> contour_curve, _2d_base_surface, _3d_base_surface, O, end_height
crv_2 = Curve(cluster_2.contour_curve)
offset = OffsetCurve(Curve=cluster_2.contour_curve, Distance=podium_hole_dimensions, Corners=1)
boundary = BoundarySurfaces(Edges=flatten([crv_2, offset]))
area_2 = Area(Geometry=boundary)  # -> Area, Centroid
mesh = MeshBrep(
    Brep=boundary,
    Settings={GridMaxCount=0, GridMinCount=16, JaggedSeams=False, MaxEdgeLength=0, MinEdgeLength=0.0001, MinTolerance=0, Refine=True, RefineAngle=0, RelativeTolerance=0.65, SimplePlanes=True, Tolerance=0})
panel_16 = Panel(area_2.Area)

area_3 = Area(Geometry=crv_2)  # -> Area, Centroid
panel_17 = Panel(area_3.Area)

move = Move(Geometry=mesh, Motion=Z)  # -> Geometry, Transform
panel_18 = Panel(floor_height_2)
Z_2 = UnitZ(Factor=panel_18)
wbthicken = WeaverbirdsMeshThicken(MeshCurves=move.Geometry, Distance=Z_2, OffsetType=0)
pshift = ShiftPaths(Data=wbthicken, Offset=-1)
panel_19 = Panel("""7
8""")
panel_20 = Panel("""0
1""")
panel_21 = Panel("""3
4
5
6""")
entwine_8 = Entwine(Branch00=panel_19, Branch01=panel_21, Branch02="2", Branch03=panel_20, FlattenInputs=True)
item_3 = ListItem(List=move.Geometry, Index=entwine_8, Wrap=True)
bang = ExplodeTree(Data=item_3)  # -> Branch0, Branch1, Branch2, Branch3

multiplication_2 = Multiplication(A=floor_height_2, B="9")

# ----
# Extrusion of Tower Programs
ma_2 = MassAddition(Input=item_2)  # -> Result, PartialResults
panel_22 = Panel(multiplication_2)
panel_23 = Panel(floor_height_2)
series_2 = Series(Start=panel_22, Step=panel_23, Count=ma_2.Result)
geometry_without_core = Geometry(curve_to_boundary_surface_2.M)
Z_3 = UnitZ(Factor=series_2)

entwine_9 = Entwine(
    Branch00=ColourSwatch(SwatchColor=RGB(214, 107, 203)),
    Branch01=ColourSwatch(SwatchColor=RGB(254, 152, 50)),
    Branch02=ColourSwatch(SwatchColor=RGB(192, 230, 245)),
    Branch03=ColourSwatch(SwatchColor=RGB(254, 203, 102)),
    Branch04=ColourSwatch(SwatchColor=RGB(254, 231, 183)),
    Branch05=ColourSwatch(SwatchColor=RGB(97, 201, 242)),
    Branch06=ColourSwatch(SwatchColor=RGB(209, 209, 209)),
    Branch07=ColourSwatch(SwatchColor=RGB(168, 204, 75)),
    Branch08=ColourSwatch(SwatchColor=RGB(128, 128, 128)),
    FlattenInputs=True)

# ----
# 03. SQM. VALIDATION
relay_7 = Relay()
relay_8 = Relay()

capsules_m2 = Panel("0")

# ----
# 04. SPECKLE PUSH
relay_9 = Relay()
relay_10 = Relay()

box = CenterBox(Base=PlaneXY(0, 0, 0), X=1, Y=1, Z=1)
mesh_2 = MeshBrep(
    Brep=box,
    Settings={GridMaxCount=0, GridMinCount=16, JaggedSeams=False, MaxEdgeLength=0, MinEdgeLength=0.0001, MinTolerance=0, Refine=True, RefineAngle=0, RelativeTolerance=0.65, SimplePlanes=True, Tolerance=0})
mcol = MeshColours(Mesh=mesh_2, Colours=ColourSwatch(SwatchColor=RGB(255, 0, 255)))
len = Length()
panel_24 = Panel("""casa
depa
cocina
oficina
recamara""")
panel_25 = Panel("""1
2
3
4
2""")
c_print = ContextPrint(FloorLabels=panel_24)
c_print_2 = ContextPrint(FloorAreas=panel_25)

# ----
# 05. VIEWPORT DATA
relay_11 = Relay()
relay_12 = Relay()

number_slider_3 = Slider(5, range=0..10)  # disabled
program_colours = Colour()  # disabled
cir = Circle(Plane=PlaneXY(0, 0, 0), Radius=number_slider_3)  # disabled
boundary_2 = BoundarySurfaces(Edges=cir)  # disabled
number_slider_4 = Slider(43, range=0..1000)  # disabled
number_slider_5 = Slider(106, range=0..1000)  # disabled
panel_26 = Panel("-16")  # disabled
lng_2 = ListLength()  # disabled
series_3 = Series(Start=0, Step=panel_26, Count=lng_2)  # disabled
Y = UnitY(Factor=series_3)  # disabled
dup = DuplicateData(Data=boundary_2, Number=lng_2, Order=True)  # disabled
vec = VectorXYZ(XComponent=number_slider_4, YComponent=number_slider_5, ZComponent=0)  # -> Vector, Length; disabled
move_2 = Move(Geometry=graft(dup), Motion=Y)  # -> Geometry, Transform; disabled
meshtoscreen = RenderMeshToScreen(
    Mesh=move_2.Geometry,
    Location=vec.Vector,
    ScaleFactor=1,
    Color=flatten(program_colours),
    Depth=0.95,
    Fixed=True,
    m_scWithvp=False)  # disabled

y_position = Slider(50, range=0..1000)  # disabled
y_separation = Slider(29, range=0..50)  # disabled
text_height = Slider(16, range=0..100)  # disabled
x_position = Slider(40, range=0..100)  # disabled
font_selector = Slider(59, range=0..345)  # disabled

wfc_seed = Data()  # disabled
panel_27 = Panel("program.")  # disabled
panel_28 = Panel(wfc_seed)  # disabled
concat = Concatenate(FragmentA=panel_27, FragmentB=panel_28)  # disabled

panel_29 = Panel("HYPERBUILDING-01")  # disabled
panel_30 = Panel("1")  # disabled
cluster_3 = Cluster(
    data_1=concat,
    data_2=panel_29,
    x_position=x_position,
    y_position=y_position,
    y_separation=y_separation,
    number_of_values=panel_30,
    text_height=text_height,
    font_selector=font_selector)  # disabled

y_position_2 = Slider(110, range=0..1000)  # disabled
x_position_2 = Slider(62, range=0..1000)  # disabled
y_separation_2 = Slider(16, range=0..50)  # disabled
text_height_2 = Slider(8, range=0..100)  # disabled
font_selector_2 = Slider(103, range=0..345)  # disabled

relay_13 = Relay()
# results
# average_sky_view
# results
# average_sky_view
# run_recipe
# Model + Grids
# average_daylight_factor
# results
relay_14 = Relay()

panel_31 = Panel(floor_height_2)  # disabled
geo_2 = Geometry()  # disabled

panel_32 = Panel(floor_height_2)
panel_33 = Panel(multiplication_2)

range = Range(Domain=Domain(0, 1), Steps=ma_2.Result)
cull_i = CullIndex(List=range, Indices="-1", Wrap=True)

range_2 = Range(Domain=Domain(0, 1), Steps=ma_2.Result)
addition = Addition(B=Z_3)

# ----
# Curvature Parameters
graph = GraphMapper(
    range_2,
    x0=0,
    x1=1,
    y0=0,
    y1=1,
    container_name="Sinc",
    Equation_X0=0.4938469529,
    Equation_X1=0.7253453135,
    Equation_Y0=0.5563363433,
    Equation_Y1=0.3827116489)
graph_2 = GraphMapper(
    cull_i,
    x0=0,
    x1=1,
    y0=0,
    y1=1,
    Ox=0.3456075788,
    Oy=0.519798398,
    Px=0.7505732179,
    Py=0.1815840006,
    container_name="Parabola")

bnd = Bounds(Numbers=graph)
remap = RemapNumbers(Value=graph, Source=bnd, Target=dom)  # -> Mapped, Clipped
vec_2 = VectorXYZ(XComponent=remap.Mapped, YComponent=remap.Mapped, ZComponent=0)  # -> Vector, Length

tower_curvature = GetNumber(Slider(1, range=1..2), AtLeast=1, AtMost=1, Maximum=1.797693135e+308, Minimum=-1.797693135e+308, TreeAccess=False)

dom_2 = ConstructDomain(DomainStart="1", DomainEnd=tower_curvature)

bnd_2 = Bounds(Numbers=graph_2)
remap_2 = RemapNumbers(Value=graph_2, Source=bnd_2, Target=dom_2)  # -> Mapped, Clipped

# ----
# STRUCTURAL CORE BOUNDING
panel_34 = Panel(floor_height_2)
remaped_direction = Data(addition)
remaped_numbers = Data(remap_2.Mapped)
xml_version_1_0_encoding_utf_8_standalon = FloorToVolume(G=polygon.Polygon, F=panel_34, T=remaped_direction, X=remaped_numbers, Y=remaped_numbers)  # -> simplify(G_2), D; "<?xml version=\"1.0\" encoding=\"utf-8\" standalone=\"yes\"?>"
loft = Loft(
    Curves=xml_version_1_0_encoding_utf_8_standalon.G_2,
    Options={Adjust=False, Closed=False, LoftEnds=0, LoftSimp=0, LoftType=0, Rebuild=10, Refit=0.01})
cap = CapHoles(Brep=loft)

# ----
# CORE
panel_35 = Panel(floor_height_2)
remaped_direction_2 = Data(addition)
remaped_numbers_2 = Data(remap_2.Mapped)
xml_version_1_0_encoding_utf_8_standalon_2 = FloorToVolume(G=curve_to_boundary_surface.M, F=panel_35, T=remaped_direction_2, X=remaped_numbers_2, Y=remaped_numbers_2)  # -> simplify(G_2), D; "<?xml version=\"1.0\" encoding=\"utf-8\" standalone=\"yes\"?>"

# ----
# CAPSULES GEOMETRY
remaped_numbers_3 = Data(remap_2.Mapped)
capsule_lenght = Panel(vertical_program_dimensions)
capsule_radius = Slider(1.8, range=0..10)
panel_36 = Panel(floor_height_2)
remaped_direction_3 = Data(addition)
moved_cluster = CapsulesCreator(
    plane=flippln.Flipped,
    corner_dimensions=Slider(0.3, range=0..1),
    lenght=capsule_lenght,
    R=capsule_radius,
    segments="12",
    floor_height=panel_36,
    remaped_direction=remaped_direction_3,
    X=remaped_numbers_3)  # -> mesh_2, G

remaped_direction_4 = Data(addition)
remaped_numbers_4 = Data(remap_2.Mapped)
cluster_4 = FloorToVolume(G=geometry_without_core, F="2.1", T=remaped_direction_4, X=remaped_numbers_4, Y=remaped_numbers_4)  # -> simplify(G_2), D

merge = Merge(Data1=xml_version_1_0_encoding_utf_8_standalon_2.G_2, Data2=cluster_4.G_2)
geo_3 = Geometry(xml_version_1_0_encoding_utf_8_standalon_2.G_2)

# ----
# Arrange
partition = PartitionList(List=cluster_4.G_2, Size=item_2)  # -> simplify(Chunks)
split = SplitTree(Data=partition, Masks=flatten("{*;0}"))  # -> Positive, Negative
split_2 = SplitTree(Data=partition, Masks=flatten("{*;1}"))  # -> Positive, Negative
split_3 = SplitTree(Data=partition, Masks=flatten("{*;2}"))  # -> Positive, Negative
entwine_10 = Entwine(Branch00=split.Positive, Branch01=split_2.Positive, Branch02=split_3.Positive, FlattenInputs=True)

office_floors = Data(split.Positive)
tstat = TreeStatistics(Tree=office_floors)  # -> Paths, Length, Count
cluster_5 = Cluster_3(crv=curve_to_boundary_surface_2.C, A=tstat.Length, floor_height=panel_32, extra_height=panel_33)  # -> contour_curve, _2d_base_surface, _3d_base_surface, O, end_height
crv_3 = Curve(cluster_5.contour_curve)
offset_2 = OffsetCurve(Curve=crv_3, Distance=podium_hole_dimensions, Corners=1)
boundary_3 = BoundarySurfaces(Edges=flatten([crv_3, offset_2]))
area_4 = Area(Geometry=boundary_3)  # -> Area, Centroid
mesh_3 = MeshBrep(
    Brep=boundary_3,
    Settings={GridMaxCount=0, GridMinCount=16, JaggedSeams=False, MaxEdgeLength=0, MinEdgeLength=0.0001, MinTolerance=0, Refine=True, RefineAngle=0, RelativeTolerance=0.65, SimplePlanes=True, Tolerance=0})

residential_floors = Data(split_2.Positive)  # disabled
tstat_2 = TreeStatistics(Tree=residential_floors)  # -> Paths, Length, Count; disabled
cluster_6 = Cluster_3(crv=curve_to_boundary_surface_2.C, A=tstat_2.Length, floor_height=panel_31, base_height=cluster_5.end_height)  # -> contour_curve, _2d_base_surface, _3d_base_surface, O, end_height; disabled
geo_4 = Geometry(mesh_3)

# ----
# CAPSULES - PROGRAM
partition_2 = PartitionList(List=moved_cluster.G, Size=item_2)  # -> simplify(Chunks)
split_4 = SplitTree(Data=partition_2, Masks=flatten("{*;0}"))  # -> Positive, Negative
split_5 = SplitTree(Data=partition_2, Masks=flatten("{*;1}"))  # -> Positive, Negative
split_6 = SplitTree(Data=partition_2, Masks=flatten("{*;2}"))  # -> Positive, Negative
entwine_11 = Entwine(Branch00=split_4.Positive, Branch01=split_5.Positive, Branch02=split_6.Positive, FlattenInputs=True)
bang_2 = ExplodeTree(Data=entwine_10)  # -> Branch0, Branch1, Branch2

geo_5 = Geometry(bang_2.Branch0)
geo_6 = Geometry(bang_2.Branch1)
geo_7 = Geometry(bang_2.Branch2)

geo_8 = Geometry(entwine_10)
geo_9 = Geometry(bang.Branch0)
geo_10 = Geometry(bang.Branch1)
geo_11 = Geometry(bang.Branch2)
geo_12 = Geometry(bang.Branch3)

entwine_12 = Entwine(
    Branch01=geo_3,
    Branch02=geo_5,
    Branch03=geo_6,
    Branch04=geo_7,
    Branch05=geo_9,
    Branch06=geo_10,
    Branch07=geo_11,
    Branch08=geo_12,
    Branch09=geo_4,
    FlattenInputs=True)
mjoin = MeshJoin(Meshes=entwine_12)
mcol_2 = MeshColours(Mesh=mjoin, Colours=entwine_9)
c_bake = ContextBake(Geometry=flatten(mcol_2))

# ----
# Program m2
area_5 = MeshArea(Mesh=merge)  # -> Area, Centroid
ma_3 = MassAddition(Input=area_5.Area)  # -> Result, PartialResults
flatten = FlattenTree(Tree=ma_3.Result, Path="{0}")
core_towers_m2 = Panel(ma_3.Result)
ma_4 = MassAddition(Input=flatten)  # -> Result, PartialResults
core_total_m2 = Panel(ma_4.Result)

area_6 = MeshArea(Mesh=geo_9)  # -> Area, Centroid
ma_5 = MassAddition(Input=flatten(area_6.Area))  # -> Result, PartialResults
labs_m2 = Panel(ma_5.Result)

area_7 = MeshArea(Mesh=geo_10)  # -> Area, Centroid
ma_6 = MassAddition(Input=flatten(area_7.Area))  # -> Result, PartialResults
podium_car_parkingl_m2 = Panel(ma_6.Result)

area_8 = MeshArea(Mesh=geo_11)  # -> Area, Centroid
ma_7 = MassAddition(Input=flatten(area_8.Area))  # -> Result, PartialResults
amenities_m2 = Panel(ma_7.Result)

area_9 = MeshArea(Mesh=geo_12)  # -> Area, Centroid
ma_8 = MassAddition(Input=flatten(area_9.Area))  # -> Result, PartialResults
car_parking_mep_m2 = Panel(ma_8.Result)

area_10 = MeshArea(Mesh=split.Positive)  # -> Area, Centroid
ma_9 = MassAddition(Input=flatten(area_10.Area))  # -> Result, PartialResults
offices_m2 = Panel(ma_9.Result)

area_11 = MeshArea(Mesh=split_2.Positive)  # -> Area, Centroid
ma_10 = MassAddition(Input=flatten(area_11.Area))  # -> Result, PartialResults
residential_m2 = Panel(ma_10.Result)

area_12 = MeshArea(Mesh=split_3.Positive)  # -> Area, Centroid
ma_11 = MassAddition(Input=flatten(area_12.Area))  # -> Result, PartialResults
hotel_m2 = Panel(ma_11.Result)

area_13 = MeshArea(Mesh=geo_4)  # -> Area, Centroid
ma_12 = MassAddition(Input=flatten(area_13.Area))  # -> Result, PartialResults
brides_m2 = Panel(ma_12.Result)

ma_13 = MassAddition(Input=[offices_m2, residential_m2, hotel_m2])  # -> Result, PartialResults

ma_14 = MassAddition(Input=[car_parking_mep_m2, amenities_m2, podium_car_parkingl_m2, labs_m2])  # -> Result, PartialResults

addition_2 = Addition(CAPSULES=capsules_m2, CORE=core_total_m2, TOWERS=ma_13.Result, BRIDGES=brides_m2, PODIUM=ma_14.Result)
panel_37 = Panel(addition_2)

# ----
# TOTAL SQM.
int = Integer(addition_2)
panel_38 = Panel(int)

# ----
# Program Colours
entwine_13 = Entwine(
    Branch00=ColourSwatch(SwatchColor=RGB(214, 107, 203)),
    Branch01=ColourSwatch(SwatchColor=RGB(254, 152, 50)),
    Branch02=ColourSwatch(SwatchColor=RGB(192, 230, 245)),
    Branch03=ColourSwatch(SwatchColor=RGB(254, 203, 102)),
    Branch04=ColourSwatch(SwatchColor=RGB(254, 231, 183)),
    Branch05=ColourSwatch(SwatchColor=RGB(97, 201, 242)),
    Branch06=ColourSwatch(SwatchColor=RGB(209, 209, 209)),
    Branch07=ColourSwatch(SwatchColor=RGB(168, 204, 75)),
    Branch08=ColourSwatch(SwatchColor=RGB(128, 128, 128)),
    FlattenInputs=True)
material = CreateMaterial(Diffuse=entwine_13, Specular=RGB(255, 255, 255), Emission=RGB(0, 0, 0), Transparency=0, Shine=0)
preview = CustomPreview(Geometry=mjoin, Material=material)

txt = Text(addition_2)
context_print = ContextPrint(RampLenght=txt)

# ----
# Visualize Data on Viewport
panel_39 = Panel(" m²")  # disabled
number_of_values = Data(lng)  # disabled
toggle = GroupToggle(ToggleActive=True, ToggleVisible=False)  # disabled

x_position_3 = Slider(328, range=0..1000)  # disabled
percentages_google_sheets = Data(ipy2.percentage)  # disabled
font_selector_3 = Slider(111, range=0..345)  # disabled
cluster_7 = Cluster(
    data_1=flatten(percentages_google_sheets),
    x_position=x_position_3,
    y_position=y_position_2,
    y_separation=y_separation_2,
    number_of_values=number_of_values,
    text_height=text_height_2,
    font_selector=font_selector_3)  # disabled

names_google_sheets_2 = Data(names_google_sheets)  # disabled
index_google_sheets_2 = Data(panel_7)  # disabled
panel_40 = Panel(".   ")  # disabled
cluster_8 = Cluster(
    data_1=flatten(index_google_sheets_2),
    data_separator=panel_40,
    data_2=names_google_sheets_2,
    x_position=x_position_2,
    y_position=y_position_2,
    y_separation=y_separation_2,
    number_of_values=number_of_values,
    text_height=text_height_2,
    font_selector=font_selector_2)  # disabled

x_position_4 = Slider(253, range=0..1000)  # disabled
font_selector_4 = Slider(112, range=0..345)  # disabled
m2_google_sheets_2 = Data(panel_6)  # disabled

concat_2 = Concatenate(FragmentA=m2_google_sheets_2, FragmentB=panel_39)  # disabled

cluster_9 = Cluster(
    data_1=flatten(concat_2),
    x_position=x_position_4,
    y_position=y_position_2,
    y_separation=y_separation_2,
    number_of_values=number_of_values,
    text_height=text_height_2,
    font_selector=font_selector_4)  # disabled

# ==== cluster Cluster
y_position = ClusterInput()
y_separation = ClusterInput()
number_of_values = ClusterInput()
x_position = ClusterInput()

series = Series(Y_position=y_position, Y_separation=y_separation, Number_of_values=number_of_values)
pt = ConstructPoint(XCoordinate=x_position, YCoordinate=series, ZCoordinate=0)

data_1 = ClusterInput()
data_separator = ClusterInput()
data_2 = ClusterInput()
concatenate = Concatenate(data_1=data_1, data_separator=data_separator, data_2=data_2)
font_selector = ClusterInput()

fonts = FontTable()
item = ListItem(List=fonts, Font_selector=font_selector, Wrap=True)

panel = Panel(fonts)
selected_font = Panel(item)
text_height = ClusterInput()
texttoscreen = RenderTextToScreen(Text=flatten(concatenate), Location=pt, Text_height=text_height, Color=RGB(0, 0, 0), Font=item, m_scWithvp=False)

# ==== cluster FloorToVolume
G = ClusterInput()
T = ClusterInput()
area = Area(Geometry=G)  # -> Area, Centroid
X = ClusterInput()
Y = ClusterInput()
scale_nu = ScaleNU(Geometry=G, Plane=area.Centroid, ScaleX=X, ScaleY=Y, ScaleZ=1)  # -> Geometry, Transform
move = Move(Geometry=scale_nu.Geometry, Motion=T)  # -> Geometry, Transform
F = ClusterInput()
G_2 = ClusterOutput(move.Geometry)

Z = UnitZ(Factor=F)
wbthicken = WeaverbirdsMeshThicken(MeshCurves=move.Geometry, Distance=Z, OffsetType=0)  # -> simplify(OutputMeshCurves)

pshift = ShiftPaths(Data=wbthicken, Offset=-1)
D = ClusterOutput(pshift)
panel = Panel(pshift)

# ==== cluster CapsulesCreator
plane = ClusterInput()
flippln = FlipPlane(Plane=plane, FlipX=False, FlipY=False, FlipZ=True)  # -> Flipped, R
floor_height = ClusterInput()
Z = UnitZ(FloorHeight=floor_height)
move = Move(Geometry=flippln.Flipped, Motion=expr("x/2", Z))  # -> Geometry, Transform
rotate = Rotate(Geometry=move.Geometry, Angle=degrees("45"), Plane=move.Geometry)  # -> Geometry, Transform
pflip = FlipPlane(Plane=rotate.Geometry, ReverseX=False, ReverseY=False, SwapAxes=True)
corner_dimensions = ClusterInput()
R = ClusterInput()
segments = ClusterInput()
neg = Negative(CornerDimensions=corner_dimensions)
polygon = Polygon(Plane=pflip, Radius=R, Segments=segments, FilletRadius=0)  # -> Polygon, Length
offset = OffsetCurve(Curve=polygon.Polygon, Distance=neg, Corners=1)
pshift = ShiftPaths(Data=offset, Offset=-1)
boundary = BoundarySurfaces(Edges=[pshift, polygon.Polygon])
lenght = ClusterInput()
Z_2 = UnitZ(Factor=lenght)
mesh = MeshBrep(
    Brep=boundary,
    Settings={GridMaxCount=0, GridMinCount=16, JaggedSeams=False, MaxEdgeLength=0, MinEdgeLength=0.0001, MinTolerance=0, Refine=True, RefineAngle=0, RelativeTolerance=0.65, SimplePlanes=True, Tolerance=0})
wbthicken = WeaverbirdsMeshThicken(MeshCurves=mesh, Distance=Z_2, OffsetType=0)  # -> simplify(OutputMeshCurves)
pshift_2 = ShiftPaths(Data=wbthicken, Offset=-1)
mjoin = MeshJoin(Meshes=pshift_2)
remaped_direction = ClusterInput()
move_2 = Move(Geometry=graft(mjoin), RemapedDirection=simplify(remaped_direction))  # -> Geometry, Transform
X = ClusterInput()  # disabled
area = Area(Geometry=move_2.Geometry)  # -> Area, Centroid
scale_nu = ScaleNU(Geometry=move_2.Geometry, Plane=area.Centroid, ScaleX=X, ScaleY=X, ScaleZ=1)  # -> Geometry, Transform
mesh_2 = ClusterOutput(wbthicken)
G = ClusterOutput(scale_nu.Geometry)

# ==== cluster Cluster_2
C = ClusterInput()
area = Area(Geometry=C)  # -> Area, Centroid
explode = Explode(Curve=C, Recursive=True)  # -> Segments, Vertices
crv_cp = CurveClosestPoint(Point=area.Centroid, Curve=explode.Segments)  # -> Point, Parameter, Distance
eval = EvaluateCurve(Curve=explode.Segments, Parameter=crv_cp.Distance)  # -> Point, Tangent, Angle
Z = UnitZ(Factor=1)
xprod = CrossProduct(VectorA=eval.Tangent, VectorB=Z, Unitize=False)  # -> Vector, Length
line = LineSDL(Start=eval.Point, Direction=xprod.Vector, CapsuleLenght=1)
face_number = ClusterInput()
move = Move(Geometry=explode.Segments, Motion=line)  # -> Geometry, Transform
divide = DivideCurve(Curve=move.Geometry, FaceNumber=expr("x+1", face_number), Kinks=False)  # -> Points, Tangents, Parameters
divide_2 = DivideCurve(Curve=explode.Segments, FaceNumber=expr("x+1", face_number), Kinks=False)  # -> Points, Tangents, Parameters

panel = Panel("""0
-1""")
cull_i = CullIndex(List=divide.Points, Indices=panel, Wrap=True)

cull_i_2 = CullIndex(List=divide_2.Points, Indices=panel, Wrap=True)
vec2pt = Vector2Pt(PointA=cull_i, PointB=cull_i_2, Unitize=False)  # -> Vector, Length
pl = PlaneNormal(Origin=cull_i_2, ZAxis=vec2pt.Vector)  # -> simplify(Plane)
pshift = ShiftPaths(Data=pl, Offset=-1)
orientation_plane = ClusterOutput(pshift)

# ==== cluster Cluster_3
A = ClusterInput()
crv = ClusterInput()
crv_2 = Curve(crv)
floor_height = ClusterInput()
multiplication = Multiplication(A=A, FloorHeight=floor_height)
base_height = ClusterInput()
addition = Addition(A=multiplication, BaseHeight=base_height)
extra_height = ClusterInput()
addition_2 = Addition(A=addition, ExtraHeight=extra_height)
Z = UnitZ(Factor=addition_2)
end_height = ClusterOutput(addition_2)
move = Move(Geometry=flatten(crv_2), Motion=Z)  # -> Geometry, Transform
disc = Discontinuity(Curve=move.Geometry, Level=1)  # -> Points, Parameters
hull2d = ConvexHull(Points=flatten(disc.Points), Plane=PlaneXY(0, 0, 0))  # -> BaseCurve, ContourCurve, Indices
contour_curve = ClusterOutput(hull2d.ContourCurve)
rdiff = RegionDifference(CurvesA=hull2d.ContourCurve, CurvesB=move.Geometry)
disc_2 = Discontinuity(Curve=hull2d.ContourCurve, Level=1)  # -> Points, Parameters
del = DelaunayMesh(Points=flatten(disc_2.Points), Plane=PlaneXY(0, 0, 0))
boundary = BoundarySurfaces(Edges=rdiff)
wbthicken = WeaverbirdsMeshThicken(MeshCurves=del, Distance=floor_height, OffsetType=0)
_2d_base_surface = ClusterOutput(boundary)
_3d_base_surface = ClusterOutput(del)
O = ClusterOutput(wbthicken)

# ==== cluster CurveToBoundarySurface
crv = ClusterInput()
D = ClusterInput()
crv_2 = Curve(crv)
offset = OffsetCurve(Curve=crv_2, Distance=D, Corners=1)

pshift = ShiftPaths(Data=offset, Offset=-1)
boundary = BoundarySurfaces(Edges=[pshift, crv_2])

C = ClusterOutput(offset)
facen = FaceNormals(Mesh=crv_2)  # -> Centers, Normals
devec = DeconstructVector(Vector=facen.Normals)  # -> XComponent, YComponent, ZComponent
smaller = SmallerThan(FirstNumber=devec.ZComponent, SecondNumber="0")  # -> SmallerThan, OrEqualTo
dispatch = Dispatch(List=boundary, DispatchPattern=smaller.SmallerThan)  # -> ListA, ListB
flip = Flip(Surface=dispatch.ListA)  # -> Surface, Result
merge = Merge(Data1=flip.Surface, Data2=dispatch.ListB)
mesh = MeshBrep(
    Brep=merge,
    Settings={GridMaxCount=0, GridMinCount=16, JaggedSeams=False, MaxEdgeLength=0, MinEdgeLength=0.0001, MinTolerance=0, Refine=False, RefineAngle=0, RelativeTolerance=0.65, SimplePlanes=True, Tolerance=0})
R = ClusterOutput(merge)
M = ClusterOutput(mesh)
