# Grasshopper definition Test.gh (Grasshopper 1.0.8)

points = GetString(AtLeast=1, AtMost=1, TreeAccess=False)
tower_segments = GetInteger(AtLeast=1, AtMost=1, Maximum=2147483647, Minimum=-2147483648, TreeAccess=False)
tower_program = GetInteger(AtLeast=1, AtMost=1, Maximum=2147483647, Minimum=-2147483648, Prompt="Program", TreeAccess=False)
floor_height = GetNumber(AtLeast=1, AtMost=1, Maximum=1.797693135e+308, Minimum=-1.797693135e+308, TreeAccess=False)
pt = Point(points)
box = CenterBox(Base=pt, X=1, Y=1, Z=1)
mesh = MeshBrep(
    Brep=box,
    Settings={GridMaxCount=0, GridMinCount=16, JaggedSeams=False, MaxEdgeLength=0, MinEdgeLength=0.0001, MinTolerance=0, Refine=True, RefineAngle=0, RelativeTolerance=0.65, SimplePlanes=True, Tolerance=0})
c_bake = ContextBake(Geometry=flatten(mesh))
