# Grasshopper definition V2.0.0_Hyper-builder_Script.gh (Grasshopper 1.0.8)
# plug-ins: Weaverbird

tower_program = GetNumber(
    [Slider(11, range=0..100), Slider(2, range=0..100)],
    AtLeast=1,
    AtMost=1,
    Maximum=1.797693135e+308,
    Minimum=-1.797693135e+308,
    TreeAccess=False)
tower_radius = GetNumber(Slider(15, range=0..100), AtLeast=1, AtMost=1, Maximum=1.797693135e+308, Minimum=-1.797693135e+308, TreeAccess=False)
pt = Point(Point(55.52929565, -43.13540255, 0))

tower_segments = GetNumber(Slider(6, range=0..10), AtLeast=1, AtMost=1, Maximum=1.797693135e+308, Minimum=-1.797693135e+308, TreeAccess=False)

points = GetString(pt, AtLeast=1, AtMost=1, TreeAccess=False)
pt_2 = Point(points)
polygon = Polygon(Plane=pt_2, Radius=tower_radius, Segments=tower_segments, FilletRadius=0)  # -> Polygon, Length

int = Integer(tower_program)
ma = MassAddition(Input=graft(int))  # -> Result, PartialResults
rotate = Rotate(Geometry=polygon.Polygon, Angle=degrees("45"), Plane=points)  # -> Geometry, Transform

# ----
# LEVEL HEIGHTS
floor_height = GetNumber(Slider(3, range=0..10), AtLeast=1, AtMost=1, Maximum=1.797693135e+308, Minimum=-1.797693135e+308, TreeAccess=False)

ma_2 = MassAddition(Input=int)  # -> Result, PartialResults
ins = InsertItems(List=ma_2.PartialResults, Item="0", Indices="0", Wrap=True)
cull_i = CullIndex(List=ins, Indices="-1", Wrap=True)
panel = Panel(cull_i)
multiplication = Multiplication(A=panel, B=floor_height)

crv = Curve(rotate.Geometry)
boundary = BoundarySurfaces(Edges=crv)
mesh = MeshBrep(
    Brep=boundary,
    Settings={GridMaxCount=0, GridMinCount=16, JaggedSeams=False, MaxEdgeLength=0, MinEdgeLength=0.0001, MinTolerance=0, Refine=False, RefineAngle=0, RelativeTolerance=0.65, SimplePlanes=True, Tolerance=0})

geometry_without_core = Geometry(mesh)
lng = ListLength(List=int)
panel_2 = Panel(floor_height)
dup = DuplicateData(Data=geometry_without_core, Number=lng, Order=True)
series = Series(Start=0, Step=panel_2, Count=ma.Result)
graft = GraftTree(Tree=dup, IncludeEmptyLists=True, IncludeNullItems=True)
Z = UnitZ(Factor=series)
simplify = SimplifyTree(Tree=Z, Front=False)
simplify_2 = SimplifyTree(Tree=graft, Front=False)
move = Move(Geometry=simplify_2, Motion=simplify)  # -> Geometry, Transform
group = Group(Geometry=move.Geometry)

panel_3 = Panel(simplify_2)
panel_4 = Panel(simplify)
panel_5 = Panel(move.Geometry)
panel_6 = Panel(group)

# ----
# Arrange
partition = PartitionList(Size=[3, 2])  # -> simplify(Chunks)
split = SplitTree(Data=partition, Masks=flatten("{*;0}"))  # -> Positive, Negative
split_2 = SplitTree(Data=partition, Masks=flatten("{*;1}"))  # -> Positive, Negative
split_3 = SplitTree(Data=partition, Masks=flatten("{*;2}"))  # -> Positive, Negative
entwine = Entwine(Branch00=split.Positive, Branch01=split_2.Positive, Branch02=split_3.Positive, FlattenInputs=True)

geo = Geometry(entwine)

Z_2 = UnitZ(Factor=multiplication)

graft_2 = GraftTree(Tree=Z_2, IncludeEmptyLists=True, IncludeNullItems=True)  # -> simplify(Tree)
panel_7 = Panel(graft_2)

move_2 = Move(Geometry=group, Motion=graft_2)  # -> Geometry, Transform
ungroup = Ungroup(Group=move_2.Geometry)

panel_8 = Panel(move_2.Geometry)
wbthicken = WeaverbirdsMeshThicken(MeshCurves=ungroup, Distance=floor_height, OffsetType=0)
pshift = ShiftPaths(Data=wbthicken, Offset=-1)

mjoin = MeshJoin(Meshes=pshift)

area = Area(Geometry=mjoin)  # -> Area, Centroid
c_bake = ContextBake(Geometry=mjoin)
area_2 = Area(Geometry=mjoin)  # -> Area, Centroid
lng_2 = ListLength(List=flatten(area_2.Area))
series_2 = Series(Start="1", Step=1, Count=lng_2)
concat = Concatenate(FragmentA="Program ", FragmentB=series_2)

panel_9 = Panel(area_2.Area)
panel_10 = Panel(concat)
c_print = ContextPrint(FloorLabels=panel_10)
c_print_2 = ContextPrint(FloorAreas=panel_9)
